# Grasshopper definition 2021-03_06_parametric portal frame.gh (Grasshopper 1.0.7)

y = Slider(0, range=0..100)
Z = Slider(0, range=0..100)
X = Slider(0, range=0..100)
frame_width = Slider(1500, range=0..5500)
width = Slider(2960, range=0..5000)
number_slider = Slider(3138, range=0..4000)
apex = Slider(951, range=0..3500)
frames = Slider(5, range=0..5)
pt = ConstructPoint(XCoordinate=X, YCoordinate=y, ZCoordinate=Z)
pt_2 = Point(pt)
vec = VectorXYZ(XComponent=width, YComponent=0, ZComponent=0)  # -> Vector, Length
vec_2 = VectorXYZ(XComponent=0, YComponent=0, ZComponent=number_slider)  # -> Vector, Length
move = Move(Geometry=pt_2, Motion=vec_2.Vector)  # -> Geometry, Transform
division = Division(A=width, B=2)
series = Series(Start=0, Step=frame_width, Count=frames)
addition = Addition(A=number_slider, B=apex)
shift = ShiftList(List=series, Shift=1, Wrap=False)
move_2 = Move(Geometry=pt_2, Motion=vec.Vector)  # -> Geometry, Transform
vec_3 = VectorXYZ(XComponent=division, YComponent=0, ZComponent=addition)  # -> Vector, Length
move_3 = Move(Geometry=pt_2, Motion=vec_3.Vector)  # -> Geometry, Transform
split = SplitList(List=shift, Index=expr("x-2", frames))  # -> ListA, ListB
move_4 = Move(Geometry=move_2.Geometry, Motion=vec_2.Vector)  # -> Geometry, Transform
vec_4 = VectorXYZ(XComponent=0, YComponent=shift, ZComponent=0)  # -> Vector, Length
vec_5 = VectorXYZ(XComponent=0, YComponent=frame_width, ZComponent=0)  # -> Vector, Length
vec_6 = VectorXYZ(XComponent=0, YComponent=split.ListA, ZComponent=0)  # -> Vector, Length
ln = Line(StartPoint=pt_2, EndPoint=move.Geometry)
pt_3 = Point([pt_2, move_2.Geometry])
ln_2 = Line(StartPoint=move_3.Geometry, EndPoint=move.Geometry)
pt_4 = Point([move.Geometry, move_3.Geometry, move_4.Geometry])
move_5 = Move(Geometry=pt_4, Motion=vec_5.Vector)  # -> Geometry, Transform
ln_3 = Line(StartPoint=flatten(pt_4), EndPoint=move_5.Geometry)
ln_4 = Line(StartPoint=move_3.Geometry, EndPoint=move_4.Geometry)
ln_5 = Line(StartPoint=move_2.Geometry, EndPoint=move_4.Geometry)
line = Line([ln, ln_2, ln_5, ln_4])
move_6 = Move(Geometry=graft([pt_4, pt_3]), Motion=vec_4.Vector)  # -> graft(Geometry), Transform
move_7 = Move(Geometry=graft(ln_3), Motion=vec_6.Vector)  # -> Geometry, Transform
move_8 = Move(Geometry=graft(line), Motion=vec_4.Vector)  # -> Geometry, Transform
geo = Geometry([ln_3, move_7.Geometry, move_6.Geometry, move_8.Geometry, line, pt_4, pt_3])
